# Dynamo graph DDS2.dyn (Dynamo 2.2.1.5175)

# group: Get stage geometries
# note: Clockwork v.2.1.2
# spring nodes v.203.1.0
categories = Categories("OST_GenericModel")
all_elements_of_category = ElementsOfCategory(Category=categories)
geometry = Element.Geometry(element=all_elements_of_category)

# group: Get bottom STAGE srf
explode = Geometry.Explode(geometry=geometry)
code_block = CodeBlock { 0.5; }
normalAtParameter = Surface.NormalAtParameter(surface=explode, u=code_block, v=code_block)
ZAxis = Vector.ZAxis()
reverse = Vector.Reverse(vector=ZAxis)
isAlmostEqualTo = Vector.IsAlmostEqualTo(vector=normalAtParameter, other=reverse)
filterByBoolMask = List.FilterByBoolMask(list=explode, mask=isAlmostEqualTo)

# group: stages centre points
code_block_2 = CodeBlock { 0.5; }
pointAtParameter = Surface.PointAtParameter(surface=filterByBoolMask.in@L2, u=code_block_2, v=code_block_2)

# group: site centre pt
flatten = List.Flatten(list=pointAtParameter)
# note: Custom Node: Clockwork v.2.1.2
average = Custom[Point.Average](points=flatten)  # Determines the average of a list of points

# group: move origin to "top of stage"
ZAxis_2 = Vector.ZAxis()
levels = Levels("Top of Stage")
elevation = Level.Elevation(level=levels)
translate = Geometry.Translate(geometry=average, direction=ZAxis_2, distance=elevation)

# group: circles
code_block_3 = CodeBlock { 2; 5; 70; }
range = Range(start=code_block_3.out0, end=code_block_3.out2, step=code_block_3.out1)
byCenterPointRadius = Circle.ByCenterPointRadius(centerPoint=translate, radius=range)

# group: spokes
XAxis = Vector.XAxis()
XY = Plane.XY()
code_block_4 = CodeBlock { 0; 360; 8; }
range_2 = Range(start=code_block_4.out0, end=code_block_4.out1, step=code_block_4.out2)
rotate = Vector.Rotate(vector=XAxis, plane=XY, degrees=range_2)
byStartPointDirectionLength = Line.ByStartPointDirectionLength(startPoint=translate, direction=rotate, length=code_block_3.out2)

intersect = Geometry.Intersect(geometry=byStartPointDirectionLength, other=byCenterPointRadius, lacing=CrossProduct)
firstItem = List.FirstItem(list=intersect@L3)

# group: pts of spokes
restOfItems = List.RestOfItems(list=intersect@L3)

# group: centre of stage
flatten_2 = List.Flatten(list=pointAtParameter)

# group: distance between division pts (lines) & stage
distanceTo = Geometry.DistanceTo(geometry=restOfItems@L2, other=flatten_2, lacing=CrossProduct)
flatten_3 = List.Flatten(list=distanceTo@L3)
sort = List.Sort(list=flatten_3)
firstItem_2 = List.FirstItem(list=sort@L2)

# group: Find max dist to get reverse power
flatten_4 = List.Flatten(list=distanceTo)
sort_2 = List.Sort(list=flatten_4)
reverse_2 = List.Reverse(list=sort_2)
firstItem_3 = List.FirstItem(list=reverse_2)

# group: attractor points efficacy
div = firstItem_3 / firstItem_2

# group: compress domain
code_block_5 = CodeBlock { 0.01; }
pow = Math.Pow(number=div, power=code_block_5)

# group: remap range of efficacies
code_block_6 = CodeBlock { 4; 20; }
remapRange = Math.RemapRange(numbers=pow, newMin=code_block_6.out0, newMax=code_block_6.out1)
code_block_7 = CodeBlock { 1; }
chop = List.Chop(list=remapRange, lengths=code_block_7)
count = List.Count(list=restOfItems@L3)
chop_2 = List.Chop(list=chop, lengths=count)

# group: move pts of spokes
ZAxis_3 = Vector.ZAxis()
translate_2 = Geometry.Translate(geometry=restOfItems, direction=ZAxis_3, distance=chop_2)

# group: pt is too far from stage
code_block_8 = CodeBlock { 40; }
gt = firstItem_2 > code_block_8
code_block_9 = CodeBlock { 1; }
chop_3 = List.Chop(list=gt, lengths=code_block_9)
count_2 = List.Count(list=restOfItems@L3)
chop_4 = List.Chop(list=chop_3, lengths=count_2)

filterByBoolMask_2 = List.FilterByBoolMask(list=translate_2, mask=chop_4)
addItemToFront = List.AddItemToFront(item=firstItem@L2, list=filterByBoolMask_2.out@L3)

# group: geometry of spokes
flatten_5 = List.Flatten(list=addItemToFront@L3)
byControlPoints = NurbsCurve.ByControlPoints(points=flatten_5)
code_block_10 = CodeBlock { 0..1..#10; }
planeAtParameter = Curve.PlaneAtParameter(curve=byControlPoints@L1, param=code_block_10)
code_block_11 = CodeBlock { 2; 0.5; }
byWidthLength = Rectangle.ByWidthLength(plane=planeAtParameter, width=code_block_11.out1, length=code_block_11.out0)
byLoft = Solid.ByLoft(crossSections=byWidthLength)

# group: circles
transpose = List.Transpose(lists=filterByBoolMask_2.out)
flatten_6 = List.Flatten(list=transpose@L3)
count_3 = List.Count(list=flatten_6@L2)
maximumItem = List.MaximumItem(list=count_3)
eq = count_3 == maximumItem
filterByBoolMask_3 = List.FilterByBoolMask(list=flatten_6, mask=eq)
byControlPoints_2 = NurbsCurve.ByControlPoints(points=filterByBoolMask_3.in)

# group: geometry of circles
code_block_12 = CodeBlock { Vector.ZAxis(); -2; }
extrude = Curve.Extrude(curve=byControlPoints_2, direction=code_block_12.out0, distance=code_block_12.out1)
code_block_13 = CodeBlock { 0.5; }
thicken = Surface.Thicken(surface=extrude, thickness=code_block_13)

# group: join lists
list_create = List.Create(item0=byLoft, item1=thicken)
flatten_7 = List.Flatten(list=list_create)

# group: geometries to Revit
string = StringInput("C:\ProgramData\Autodesk\RVT 2020\Family Templates\English_I\Generic Model.rft")
count_4 = List.Count(list=flatten_7)
code_block_14 = CodeBlock(x=count_4) { "Radial Beam #"+(1..x); }
# note: Custom Node: spring nodes v.203.1.0
ꟿ_familyinstance_bygeometry = Custom[ꟿ FamilyInstance.ByGeometry](geometry=flatten_7, familyTemplatePath=string, familyName=code_block_14)  # You must provide a valid family template path that will be used for all input geometry objects. The project units(and not the templates) will be used to determine the size of the output geometry. The provided category will be used only if the family template supports it. If not, the default template category will be used instead. Likewise, the family material(provided as a string) will be set only if a material with that name exists in the template. If not, the default material will be used instead ("By Category"). For void cuts, the material settings will be ignored. The Subcategory name is an optional input. If you'd like to skip assigning a Subcategory to any new instance, simply use null. The node expects a unique family name for each geometry object. The rest of the input lists will be processed as if the node lacing is set to longest.
